# Grasshopper definition BeamDeflection.gh (Grasshopper 0.9.76)

list = ValueList({"Uniform distributed load": 0, "Point load in middle or end(cantilever)": 1}, selected="Uniform distributed load")
list_2 = ValueList({"Simply supported in both ends": 0, "Cantilever": 1}, selected="Cantilever")

# ---- group: Type
num = Number(list)

# ---- group: Load
num_2 = Number(Slider(20, range=0..100))

# ----
time_step = Number(Slider(0, range=0..240))

# ---- group: Width
num_3 = Number(Slider(250, range=0..1000))

# ---- group: Height
num_4 = Number(Slider(500, range=0..1000))

# ---- group: Support
num_5 = Number(list_2)

# ---- group: Beam
brep = Brep(<brep referenced from the Rhino model>)

# ---- group: Multiplication Factor
num_6 = Number(Slider(59, range=1..100))

# ----
division = Division(A=num_4, B=1000)
division_2 = Division(A=num_3, B=1000)

# ----
# Concrete strength var.
minutes = Panel("0 to 240")
remap = RemapNumbers(Value=time_step, Source=minutes, Target=Domain(0, 1))  # -> Mapped, Clipped
range = Range(Domain=Domain(0, 1), Steps=10)
graph = GraphMapper(
    remap.Mapped,
    x0=0,
    x1=1,
    y0=0,
    y1=1,
    container_name="Bezier",
    cpx=[0, 0.148027271, 0.6342856288, 1],
    cpy=[1, 0.3492753506, 0.2620283365, 0.4188405871])
remap_2 = RemapNumbers(Value=graph, Source="0 to 1", Target="0 to 210")  # -> Mapped, Clipped
e_gpa = Panel(remap_2.Mapped)

expression = Expression(w=division_2, h=division, Expression="1/12*w*h^3")
i_m4 = Panel(expression)

# ----
# Initial Beam
brep_2 = Brep(brep)

debrep = DeconstructBrep(Brep=brep_2)  # -> Faces, Edges, Vertices
srf = Surface(debrep.Faces)
area = Area(Geometry=srf)  # -> Area, Centroid
item = ListItem(List=area.Centroid, Index=0, Wrap=True)  # -> Item, Item1, Item2, Item3, Item4, Item5
ln = Line(StartPoint=item.Item, EndPoint=item.Item5)
len = Length(Curve=ln)
expression_2 = Expression(q=num_2, L=len, E=e_gpa, I=i_m4, Expression="(5/384*q*1000*(L/1000)^4/(E*10^9*I))*1000")
umax_mm = Panel(expression_2)
num_7 = Number(expression_2)
multiplication = Multiplication(A=num_7, B=num_6)

eval = EvaluateCurve(Curve=reparameterize(ln), Parameter=Slider(0.5, range=0..1))  # -> Point, Tangent, Angle
Z = UnitZ(Factor=expr("x*-1", multiplication))
move = Move(Geometry=eval.Point, Motion=Z)  # -> flatten(Geometry), Transform

# ----
# Re-create beam on curved line
number_slider = Slider(1, range=0..1)
eval_2 = EvaluateCurve(Curve=reparameterize(ln), Parameter=number_slider)  # -> flatten(Point), Tangent, Angle
eval_3 = EvaluateCurve(Curve=reparameterize(ln), Parameter=Slider(0, range=0..1))  # -> flatten(Point), Tangent, Angle
rev = Reverse(Vector=eval_2.Tangent)
rev_2 = Reverse(Vector=eval_3.Tangent)
pt = Point([eval_2.Point, move.Geometry, eval_3.Point])
intcrv_t = InterpolateT(Vertices=pt, Degree=3, TangentStart=rev, TangentEnd=rev_2, KnotStyle=1)  # -> Curve, Length, Domain
intcrv = Interpolate(Vertices=pt, Degree=3, Periodic=False, KnotStyle=1)  # -> Curve, Length, Domain

# ----
# Orient end surface
item_2 = ListItem(List=srf, Index=0, Wrap=True)  # -> Item, Item1
srf_2 = Surface(item_2.Item)
eval_4 = EvaluateCurve(Curve=reparameterize(intcrv.Curve), Parameter=Slider(1, range=0..1))  # -> Point, Tangent, Angle
pl = PlaneNormal(Origin=eval_3.Point, ZAxis=rev_2)
pl_2 = PlaneNormal(Origin=eval_4.Point, ZAxis=eval_4.Tangent)
prot = RotatePlane(Plane=pl_2, Angle=degrees(-90))
orient = Orient(Geometry=srf_2, Source=pl, Target=prot)  # -> Geometry, Transform

swp1 = Sweep1(Rail=intcrv.Curve, Sections=orient.Geometry, Miter=1)
cap = CapHoles(Brep=swp1)

# ---- group: Deflected Beam
brep_3 = Brep(cap)

# ---- group: Umax
num_8 = Number(expression_2)
